# Dynamo graph WORKSHOP_FRAMING.dyn (Dynamo 2.0.2.6826)

python_csv_create = Python()
# ---------- python_csv_create.python (28 lines) ----------
import clr
import System

class framing:
	def __init__(self, data):
		self.id = data[0]
		self.designType = data[1]
		self.End_X = data[2]
		self.End_Y = data[3]
		self.End_Z = data[4]
		self.Start_X = data[5]
		self.Start_Y = data[6]
		self.Start_Z = data[7]
		
filePath = "E:/SFDUG/PythonWorkshop/CSV_files/framing.csv"

fileReader = System.IO.StreamReader(filePath)

out = []

while fileReader.Peek() > -1: 
	line = fileReader.ReadLine()
	row = line.Split(",")
	obj = framing(row)
	out.append(obj)
	
OUT = out
	
# ----------------------------------------
python_update_structural_framing = Python()  # unwired: IN[0]; empty script
python_csv_update = Python()
# ---------- python_csv_update.python (29 lines) ----------
import clr 
import System

class framing:
	def __init__(self, row):
		self.id = row[0]
		self.designType  = row[1]
		self.End_X = row[2]
		self.End_Y = row[3]
		self.End_Z = row[4]
		self.Start_X = row[5]
		self.Start_Y = row[6]
		self.Start_Z = row[7]
		
filepath = "E:/SFDUG/PythonWorkshop/CSV_files/framingUpdate.csv"
fileReader = System.IO.StreamReader(filepath)

out = []

while fileReader.Peek() > -1:
	line = fileReader.ReadLine()
	row = line.Split(",")
	obj = framing(row)
	out.append(obj)
	
fileReader.Close()

OUT = out
	
# ----------------------------------------
python_graphic_override = Python()  # unwired: IN[0]; empty script
fill_patterns = FillPatterns(index=1)
python_move_elements = Python()  # empty script
python_create_sheets = Python()  # unwired: IN[0]; empty script
family_types = FamilyTypes(index=15)
python_rotate_elements = Python()  # empty script
python_apply_view_template = Python()  # empty script
python_get_linked_document = Python()  # empty script
python_create_structural_framing = Python()  # unwired: IN[0]; empty script
watch = Watch(python_create_structural_framing)
